# Dynamo graph Basic_Primitive_Nodes.dyn (Dynamo 3.0.3.7597)

code_block = CodeBlock { 3; 5; -0.5; 8; 13; Math.PI * 2; Math.PI; }
byOrigin = CoordinateSystem.ByOrigin(x=code_block.out0)
byConeAxisRadiusHeight = AnyCAD.UserNodes.Elements.UserShapeNode.ByConeAxisRadiusHeight(ax=byOrigin, height=code_block.out0)
byOrigin_2 = CoordinateSystem.ByOrigin(x=code_block.out1, y=code_block.out2)
byBoxAxisLengths = AnyCAD.UserNodes.Elements.UserShapeNode.ByBoxAxisLengths(cs=byOrigin_2)
byOrigin_3 = CoordinateSystem.ByOrigin(x=code_block.out3)
byCylinderAxisRadiusHeight = AnyCAD.UserNodes.Elements.UserShapeNode.ByCylinderAxisRadiusHeight(ax=byOrigin_3, height=code_block.out1)
bySphereCenterRadius = AnyCAD.UserNodes.Elements.UserShapeNode.BySphereCenterRadius()
byOrigin_4 = CoordinateSystem.ByOrigin(x=code_block.out4)
byTorusMajorMinorAngle = AnyCAD.UserNodes.Elements.UserShapeNode.ByTorusMajorMinorAngle(ax=byOrigin_4, angle=code_block.out5)
